vi "index.gviweb"   [LabVIEW NXG 5.0.0]
panel controls:
  "Stop Data Collection": bool
  "Start Data Collection": bool
  "Save Data": bool
panel indicators:
  "headers": string
  "body": string
  "Temperature": f64
  "Chassis Temperature": f64
uses:
  NI::HTTP::GET.gvi
diagram:
  # Get data from LabVIEW Web service, unflatten the data, and format it so it can be displayed in a single graph.
  #
  # Post data to LabVIEW Web service, unflatten the  response data, format the data, and plot on two graphs
  while {
    Boolean To 0 Or 1(Boolean=$"Save Data") -> (0, 1=w1)
    Number To Decimal String(number=w1, width (-)=0) -> (decimal integer string=w2)
    Boolean To 0 Or 1(Boolean=$"Stop Data Collection") -> (0, 1=w3)
    Number To Decimal String(number=w3, width (-)=0) -> (decimal integer string=w4)
    Boolean To 0 Or 1(Boolean=$"Start Data Collection") -> (0, 1=w5)
    Number To Decimal String(number=w5, width (-)=0) -> (decimal integer string=w6)
    Concatenate Strings("http://127.0.0.1:80/TutorialService/FPGA?RP_SaveData=", w2, "&RP_Stop=", w4, "&RP_Start=", w6) -> w7
    call "GET.gvi"(url=w7) -> (headers=w8, body=w9)
    $headers <- w8
    $body <- w9
    s1 = w9  # shift register
    while {
      Match Pattern(regular expression=",", string=s1) -> (after substring=w11, before substring=w12)
      Match Pattern(regular expression=":", string=w12) -> (after substring=w13)
      Scan Value(format string="%f", string=w13) -> (value=w14)
      Is Empty String Or Path(string/path=w11) -> w15
      append w14 to w10
      next s1 = w11
      stop if w15
    }
    Array Index(array=w10) -> (out0[0]=w16)
    $Temperature <- w16
    $"Chassis Temperature" <- w16
    stop if FALSE
  }
